test file "Transmission_Test_Suite"

suite "10-Speed Transmission Controller"

  case "ETRS 3" [baseline]
    model TransmissionControl, mode Normal, start time 0, stop time 65
    assessment "ETRS 3.1": At any point of time, whenever DriveRangeSelector == Park & VehicleSpeed <= 0.1 is true then, with no delay, GearCommanded == 0 must be true
      GearCommanded: signal TransmissionControl/Transmission Controller, port 2
      DriveRangeSelector: signal TransmissionControl/Variant Source2, port 1
      VehicleSpeed: signal TransmissionControl/LongitudinalVehiclePlant, port 3
      Park: expression RangeSelected.Park

  case "ETRS 4" [simulation]
    model TransmissionControl, variant configuration Test
    input "ETRS_0-60Log.mat", mapped to DriverBrake, DriverThrottle, DriverGearSelection (active)
    assessment "ETRS 4": At any point of time, if VehSpd > 0.1 becomes true then, with a delay of at most 12, VehSpd > 60 must be true
      VehSpd: signal TransmissionControl/Signal Specification, port 1

suite "Gear Safety Tests"

  case "GS-01" [simulation]
    model TransmissionController, harness TransmissionController_Harness1 (for TransmissionController/GS-01), mode Normal, start time 0, stop time 12
    input "GS-01_testCase.mat", mapped to Driver Range Selection -> acceptedRange, candidateGear (active)
    assessment "Assessment1": At any point of time, ~(acceptedRange == 1 | acceptedRange == 2) | (gearCommand == 0) must be true
    assessment "Assessment2": At any point of time, ~(acceptedRange == 0) | (gearCommand == -1) must be true
    assessment "Assessment3": At any point of time, ~(acceptedRange == 3 & candidateGear >= 1 & candidateGear <= 10) | (gearCommand == candidateGear) must be true
    assessment "Assessment4": At any point of time, ~(acceptedRange == 3 & candidateGear > 10) | (gearCommand == 10) must be true
    assessment "Assessment5": At any point of time, ~(acceptedRange == 3 & candidateGear < 1) | (gearCommand == 1) must be true
      acceptedRange: signal TransmissionController_Harness1/Input Conversion Subsystem, port 1
      candidateGear: signal TransmissionController_Harness1/Input Conversion Subsystem, port 2
      gearCommand: signal TransmissionController_Harness1/GS-01, port 1

  case "GS-03" [simulation]
    model TransmissionController, harness TransmissionController_Harness2 (for TransmissionController/GS-03)
    input "GS-03_testCase.mat", mapped to engineSpeed, nominalShift (active)
    assessment "Assessment1": At any point of time, ~(engineSpeed <= 7250) | (safeShift == nominalShift) must be true
    assessment "Assessment2": At any point of time, ~(engineSpeed > 7250) | (safeShift == 1) must be true
      engineSpeed: signal TransmissionController_Harness2/Input Conversion Subsystem, port 1
      safeShift: signal TransmissionController_Harness2/GS-03, port 1
      nominalShift: signal TransmissionController_Harness2/Input Conversion Subsystem, port 2

suite "Performance and Efficiency Tests"

  case "PE-01" [simulation]
    description: At gear 3 and 5200 RPM, change only throttle from 0.2 to 0.8 and back; expect request true, false, true.
    model TransmissionController, harness TransmissionController_Harness4 (for TransmissionController/PE-01), mode Normal, start time 0, stop time 6
    input "PE-01 Input data file.mat", mapped to AcceptedRange, CurrentGear, EngineSpeed, DriverThrottle (active)
    logged signals "Signal Set 1": PE-01:1, AcceptedRange:1, CurrentGear:1, EngineSpeed:1, DriverThrottle:1

  case "New Test Case 1" [simulation]