% Simulink data dictionary ETRS_data.sldd

RangeSelected = enum(DefaultValue="Neutral", StorageType="uint8")
  Reverse = 0
  Neutral = 1
  Park = 2
  Drive = 3

RunType = enum(DefaultValue="Simulate")
  Simulate = 0
  Test = 1

V = RunType.Simulate

vConfigData = Simulink.VariantConfigurationData(
  struct(
    Configurations=[struct(
      Name="Simulate",
      Description="This is an auto-generated configuration.",
      ControlVariables=struct(Name="V", Value=RunType.Simulate, Source="ETRS_data.sldd")), struct(
      Name="Test",
      Description="This is an auto-generated configuration.",
      ControlVariables=struct(Name="V", Value=RunType.Test, Source="ETRS_data.sldd"))],
    VariantConfigurations=[struct(
      Name="Simulate",
      Description="This is an auto-generated configuration.",
      ControlVariables=struct(Name="V", Value="RunType.Simulate", Source="ETRS_data.sldd"),
      SubModelConfigurations=[]), struct(
      Name="Test",
      Description="This is an auto-generated configuration.",
      ControlVariables=struct(Name="V", Value="RunType.Test", Source="ETRS_data.sldd"),
      SubModelConfigurations=[])],
    Constraints=[],
    PreferredConfiguration="Simulate",
    DefaultConfigurationName="",
    DataDictionaryName="ETRS_data.sldd",
    DataDictionarySection="",
    AreSubModelConfigurationsMigrated=true,
    ComponentConfigurationData=[],
    Version="26.1"))